# Grasshopper definition box-humanui.gh (Grasshopper 1.0.7)
# plug-ins: Human UI

box_size = Slider(92, range=0..100)
wall_thickness = Slider(12, range=0..100)
box_height = Slider(100, range=0..100)
X = UnitX(Factor=box_size)
X_2 = UnitX(Factor=wall_thickness)
Z = UnitZ(Factor=box_height)
pt = ConstructPoint(XCoordinate=0, YCoordinate=0, ZCoordinate=0)
neg = Negative(Value=X_2)
move = Move(Geometry=pt, Motion=neg)  # -> Geometry, Transform
move_2 = Move(Geometry=pt, Motion=Z)  # -> Geometry, Transform
ln = Line(StartPoint=pt, EndPoint=move_2.Geometry)
ln_2 = Line(StartPoint=move.Geometry, EndPoint=pt)
number_of_joints = Slider(10, range=2..50)
len = Length(Curve=ln)
extr = Extrude(Base=ln, Direction=X)
division = Division(A=box_size, B=2)
Y = UnitY(Factor=division)
area = Area(Geometry=extr)  # -> Area, Centroid
division_2 = Division(A=len, B=number_of_joints)
move_3 = Move(Geometry=area.Centroid, Motion=Y)  # -> Geometry, Transform
multiplication = Multiplication(A=division_2, B=2)
Z_2 = UnitZ(Factor=division_2)
division_3 = Division(A=number_of_joints, B=2)
yz = YZPlane(Origin=area.Centroid)
series = Series(Start=0, Step=multiplication, Count=division_3)
extr_2 = Extrude(Base=ln_2, Direction=Z_2)
Z_3 = UnitZ(Factor=Z_2)
Z_4 = UnitZ(Factor=series)
move_4 = Move(Geometry=extr_2, Motion=Z_3)  # -> Geometry, Transform
move_5 = Move(Geometry=move_4.Geometry, Motion=Z_4)  # -> Geometry, Transform
move_6 = Move(Geometry=extr_2, Motion=Z_4)  # -> Geometry, Transform
mirror = Mirror(Geometry=move_6.Geometry, Plane=yz)  # -> Geometry, Transform
join = BrepJoin(Breps=flatten([mirror.Geometry, move_5.Geometry, extr]))  # -> Breps, Closed
fmerge = MergeFaces(Brep=join.Breps)  # -> Breps, Before, After
division_4 = Division(A="360", B="4")
amp = Amplitude(Vector=fmerge.Breps, Amplitude=wall_thickness)
series_2 = Series(Start=0, Step=division_4, Count="4")
extr_3 = Extrude(Base=fmerge.Breps, Direction=amp)
debrep = DeconstructBrep(Brep=extr_3)  # -> Faces, Edges, Vertices
midpt = CurveMiddle(Curve=debrep.Edges)
fillet = Slider(0.5, range=0..10)
lng = ListLength(List=flatten(midpt))
series_3 = Series(Start=0, Step=1, Count=lng)
filedge = FilletEdge(Shape=extr_3, Blend=0, Metric=0, Edges=series_3, Radii=fillet)
walls = Rotate(Geometry=filedge, Angle=degrees(series_2), Plane=move_3.Geometry)  # -> Geometry, Transform
sunion = SolidUnion(Breps=walls.Geometry)
box = Box(sunion)
Z_5 = UnitZ(Factor=Slider(3.5, range=0..10))
debrep_2 = DeconstructBrep(Brep=box)  # -> Faces, Edges, Vertices
neg_2 = Negative(Value=Z_5)
item = ListItem(List=debrep_2.Faces, Index=4, Wrap=True)
base = Extrude(Base=item, Direction=neg_2)
slider = CreateSlider(
    Slider=[fillet, number_of_joints, wall_thickness, box_height, box_size],
    ShowBounds=False,
    ShowTicks=False,
    ShowTooltip=False,
    ShowValLabel=True,
    showLabel=True)
_3dview = Create3DView(
    MeshToDisplay=base,
    MeshColors=RGB(255, 0, 0),
    ViewWidth=Slider(300, range=0..1000),
    ViewHeight=Slider(300, range=0..1000))
merge = Merge(Data1=_3dview, Data2=slider)
values = ValueListener(Elements=slider, SomeProperty=True)  # -> Values, Indices
launchwin = LaunchWindow(
    Show=Toggle(True),
    Name="compost bin parameter",
    Width=Slider(640, range=0..1000),
    Height=Slider(800, range=0..1000),
    FontFamily="Ariel",
    ChildStatus=0,
    EnableHorizScroll=False)
addelems = AddElements(Window=launchwin, Elements=flatten(merge), DoVLChecking=True)  # -> AddedElements, ElementNames
colour = ColourPicker(PickedColour=RGB(97, 52, 52))
set3dview = Set3DView(_3DView=_3dview, MeshToDisplay=base, MeshColors=colour)
